vi "CountingPipes.gvi"   [LabVIEW NXG 5.1.0]
panel controls:
  "timeout (1000)": i32 = 10000  # timeout specifies the amount of time in milliseconds to wait for a response from the server before the Web request times out. The default value is 10000 ms. A value of -1 defers timeout monitoring to the operating system.
  "Max Radius": f32 = 100
  "Min Radius": f32 = 3
  "Operation": T1 = "Dilate"
  "Method": i32 = "metric"(2)
  "Color Plane": i32 = "Intensity"(7)
  "error in": error
panel indicators:
  "Image Output": "Vision IMAQImage"
  "error out": error
  "Object Data (calibrated)": T2[]  # Circles Data returns an array of measurements for all detected circles.
  "Object Data": T2[]  # Circles Data returns an array of measurements for all detected circles.
  "NUMBER OF PIPES": i32  # Nb Circles returns the number of detected circles in the image.
types:
  T1 = enum{"AutoM", "Close", "Dilate", "Erode", "Gradient", "Gradient out", "Gradient in", "Hit miss", "Open", "PClose", "POpen", "Thick", "Thin"}
  T2 = cluster{"Pos. X": i32, "Pos. Y": i32, "Radius": i32, "Core Area": i32}
  T3 = enum{"Don't use min max", "Use file values", "Use optional values"}
  T4 = enum{"Big endian (Motorola)", "Little endian (Intel)"}
  T5 = cluster{"Read Raw File": i32, "File Data Type": u32, "Offset to Data": i32, "Use Min Max": T3, "Optional Min Value": f32, "Optional Max Value": f32, "Byte Order": T4}
uses:
  NI::HTTP::Open HTTP Handle.gvi
  NI::Vision::Core::Basics::Create Image.gvi
  NI::Vision::Core::Files::Read Image File.gvi
  NI::Vision::Algorithms::Color::Extract Single Color Plane.gvi
  NI::Vision::Algorithms::Processing::Binary Auto Threshold.gvi
  NI::Vision::Algorithms::Morphology::Morphology.gvi
  NI::Vision::Algorithms::Morphology::Fill Hole.gvi
  NI::Vision::Algorithms::Morphology::Find Circles.gvi
  NI::HTTP::POST Buffer.gvi
  NI::Vision::Core::Basics::Dispose Image.gvi
  NI::Vision::Assistant Utilities::Store Circles Results.gvi
  NI::HTTP::Close HTTP Handle.gvi
diagram:
  File Dialog[FileDialogSelectionMode=File, NewOrExistingMode=Existing](prompt="Select an image file...") -> (selected path=w1)
  call "Open HTTP Handle.gvi"() -> (client handle out=w2, error out=w3)
  while {
    Call Chain() -> (callchain=w4)
    Array Index(array=w4) -> (out0[_]=w5)
    call "Create Image.gvi"(image name=w5, image type="RGB (U32)"(4), error in=$"error in") -> (new image=w6, error out=w7)
    call "Read Image File.gvi"(use file path image type=FALSE, image in=w6, file path=w1, load color palette=FALSE, file options=T5 {all zero or empty}, error in=w7) -> (image out=w8, error out=w9)
    call "Extract Single Color Plane.gvi"(image src=w8, color plane=$"Color Plane", error in=w9) -> (image dst out=w10, error out=w11)
    w12 = cluster{"Lower value": f32, "Upper value": f32} {"Lower value"=10, "Upper value"=245}
    call "Binary Auto Threshold.gvi"(threshold limits=w12, image src=w10, method=$Method, error in=w11, object type="Dark Objects"(1)) -> (image dst out=w13, error out=w14)
    call "Morphology.gvi"(square/hexagonal?=FALSE, image src=w13, operation="AutoM", error in=w14) -> (image dst out=w15, error out=w16)
    call "Fill Hole.gvi"(image src=w15, connectivity 4/8?=TRUE, error in=w16) -> (image dst out=w17, error out=w18)
    Random Number() -> (number (0 to 1)=w19)
    Format Into String(formatString="IVA Circle Image %.9f", w19) -> w20
    call "Create Image.gvi"(image name=w20, error in=w18) -> (new image=w21, error out=w22)
    call "Find Circles.gvi"(image src=w17, image dst=w21, minimum radius=$"Min Radius", maximum radius=$"Max Radius", error in=w22) -> (circles information=w23, number of circles=w24, error out=w25)
    Number To Fractional String(number=w24) -> (F-format string=w26)
    Concatenate Strings("key=CVHMBP2KBM4ZZUXY&field1=0", w26) -> w27
    call "POST Buffer.gvi"(timeout=$"timeout (1000)", client handle=w2, url="  https://api.thingspeak.com/update?api_", buffer=w27, error in=w3) -> (client handle out=w28, error out=w29)
    $"NUMBER OF PIPES" <- w24
    $"Object Data" <- w23
    call "Dispose Image.gvi"(image=w21, error in=w25) -> (error out=w30)
    call "Store Circles Results.gvi"(image=w17, circles data=w23, step name="Circle Detection 1", error in=w30) -> (image dup=w31, calibrated circles data=w32, error out=w33)
    $"Image Output" <- w31
    Property Node(instance in=reference to "Image Output", "PaletteType"="Binary"(1), error in=w33) -> (error out=w34)  # Vision Image Display properties
    $"error out" <- w34
    $"Object Data (calibrated)" <- w32
    stop if FALSE
  }
  call "Close HTTP Handle.gvi"(client handle=w28, error in=w29)
